# Grasshopper definition TopologyLineFilter.gh (Grasshopper 1.0.7)
# plug-ins: Sandbox Topology

crv = Curve([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])
# © 2025 by Tobias Schwinn
crv_2 = Curve([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])
flatten = FlattenTree(Tree=crv_2, Path="{0}")
flatten_2 = FlattenTree(Tree=crv, Path="{1}")
merge = Merge(Data1=flatten, Data2=flatten_2)
line = Line(merge)
valency = Slider(3, range=1..6)
eval = EvaluateLength(Curve=line, Length=0.5, Normalized=True)  # -> Point, Tangent, Parameter
points = PointList(Points=eval.Point, Tags=True, Lines=False, Size=15)

linetopoidx = LineTopologyIndex(ListOfLines=line, Tolerance=0.001)  # -> ListOfPoints, LinePointStructure, PointPointStructure, PointLineStructure

pshift = ShiftPaths(Data=linetopoidx.PointLineStructure, Offset=-1)
points_2 = PointList(Points=linetopoidx.ListOfPoints, Tags=True, Lines=False, Size=10)
pp = Panel(linetopoidx.PointLineStructure)
item = ListItem(List=line, Index=pshift, Wrap=True)
unflatten = UnflattenTree(Tree=item, Guide=linetopoidx.PointLineStructure)

line_filter = LineTopologyFilter(ListOfPoints=linetopoidx.ListOfPoints, PointLineStructure=unflatten, ValencyFilter=valency)  # -> ListOfPoints, LineStructure

sph = Sphere(Base=line_filter.ListOfPoints, Radius=20)
pipe = Pipe(Curve=line_filter.LineStructure, Radius=5, Caps=0)
